# Grasshopper definition CreateOasysProfile.gh (Grasshopper 1.0.7)
# Copyright: Arup
# plug-ins: OasysGHTestComponents

crv = Curve(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)
profile = CreateProfile(
    InclSuperseeded="true",
    catalogueIndex=2,
    inclSS=True,
    lengthUnit="Centimeter",
    mode="Catalogue",
    Profile_type="Catalogue",
    Catalogue="British",
    Type="All",
    Profile="All",
    typeIndex=248)
profile_2 = CreateProfile(
    catalogueIndex=2,
    inclSS=False,
    lengthUnit="Centimeter",
    mode="Catalogue",
    Profile_type="Catalogue",
    Catalogue="British",
    Type="Parallel flange I sections(IPE) - EN10365:2017",
    Profile="BSI-IPE IPE100",
    typeIndex=248)
profile_3 = CreateProfile(
    InclSuperseeded="false",
    catalogueIndex=2,
    inclSS=False,
    lengthUnit="Centimeter",
    mode="Catalogue",
    Profile_type="Catalogue",
    Catalogue="British",
    Type="All",
    Profile="All",
    typeIndex=248)
profile_4 = CreateProfile(
    Boundary=crv,
    catalogueIndex=-1,
    inclSS=False,
    lengthUnit="Centimeter",
    mode="Other",
    Profile_type="Perimeter",
    Measure="cm",
    typeIndex=-1)
profile_5 = CreateProfile(
    Depth_cm="500",
    Width_cm="100",
    WebThk_cm="10",
    FlangeThk_cm="20",
    catalogueIndex=-1,
    inclSS=False,
    lengthUnit="Centimeter",
    mode="Other",
    Profile_type="I Beam Symmetrical",
    Measure="cm",
    typeIndex=-1)
profile_6 = CreateProfile(
    Depth_cm="500",
    TopFlangeWidth_cm="100",
    BottomFlangeWidth_cm="10",
    WebThickness_cm="20",
    TopFlangeThk_cm="30",
    BottomFlangeThk_cm="30",
    catalogueIndex=-1,
    inclSS=False,
    lengthUnit="Centimeter",
    mode="Other",
    Profile_type="I Beam Asymmetrical",
    Measure="cm",
    typeIndex=-1)
profile_7 = CreateProfile(
    Depth_cm="500",
    TopWidth_cm="100",
    BottomWidth_cm="10",
    catalogueIndex=-1,
    inclSS=False,
    lengthUnit="Centimeter",
    mode="Other",
    Profile_type="Trapezoid",
    Measure="cm",
    typeIndex=-1)
profile_8 = CreateProfile(
    Depth_cm="500",
    Width_cm="100",
    WebThk_cm="10",
    FlangeThk_cm="20",
    catalogueIndex=-1,
    inclSS=False,
    lengthUnit="Centimeter",
    mode="Other",
    Profile_type="Angle",
    Measure="cm",
    typeIndex=-1)
profile_9 = CreateProfile(
    Diameter_cm="10",
    catalogueIndex=-1,
    inclSS=False,
    lengthUnit="Centimeter",
    mode="Other",
    Profile_type="Circle",
    Measure="cm",
    typeIndex=-1)
profile_10 = CreateProfile(
    Depth_cm="500",
    Width_cm="100",
    WebThk_cm="10",
    FlangeThk_cm="20",
    catalogueIndex=-1,
    inclSS=False,
    lengthUnit="Centimeter",
    mode="Other",
    Profile_type="Cruciform Symmetrical",
    Measure="cm",
    typeIndex=-1)
profile_11 = CreateProfile(
    Depth_cm="500",
    Width_cm="100",
    catalogueIndex=-1,
    inclSS=False,
    lengthUnit="Centimeter",
    mode="Other",
    Profile_type="Recto Circle",
    Measure="cm",
    typeIndex=-1)
profile_12 = CreateProfile(
    Diameter_cm="500",
    PileCentres_cm="100",
    PileCount="10",
    IsWall=Toggle(False),
    catalogueIndex=-1,
    inclSS=False,
    lengthUnit="Centimeter",
    mode="Other",
    Profile_type="Secant Pile",
    Measure="cm",
    typeIndex=-1)
profile_13 = CreateProfile(
    Depth_cm="500",
    DepthFlat_cm="100",
    Width_cm="10",
    WidthFlat_cm="20",
    catalogueIndex=-1,
    inclSS=False,
    lengthUnit="Centimeter",
    mode="Other",
    Profile_type="Recto Ellipse",
    Measure="cm",
    typeIndex=-1)
profile_14 = CreateProfile(
    Depth_cm="50",
    Width_cm="10",
    WebThk_cm="1",
    FlangeThk_cm="2",
    catalogueIndex=-1,
    inclSS=False,
    lengthUnit="Centimeter",
    mode="Other",
    Profile_type="Channel",
    Measure="cm",
    typeIndex=-1)
profile_15 = CreateProfile(
    Depth_cm="500",
    Width_cm="100",
    catalogueIndex=-1,
    inclSS=False,
    lengthUnit="Centimeter",
    mode="Other",
    Profile_type="Rectangle",
    Measure="cm",
    typeIndex=-1)
profile_16 = CreateProfile(
    Diameter_cm="5",
    Thickness_cm="0.1",
    catalogueIndex=-1,
    inclSS=False,
    lengthUnit="Centimeter",
    mode="Other",
    Profile_type="Circle Hollow",
    Measure="cm",
    typeIndex=-1)
profile_17 = CreateProfile(
    Depth_cm="500",
    Width_cm="100",
    Lip_cm="10",
    Thickness_cm="20",
    catalogueIndex=-1,
    inclSS=False,
    lengthUnit="Centimeter",
    mode="Other",
    Profile_type="General C",
    Measure="cm",
    typeIndex=-1)
profile_18 = CreateProfile(
    Depth_cm="500",
    Width_cm="100",
    WebThk_cm="10",
    FlangeThk_cm="20",
    WebOpening_cm="300",
    Pitch_cm="3000",
    catalogueIndex=-1,
    inclSS=False,
    lengthUnit="Centimeter",
    mode="Other",
    Profile_type="I Beam Cellular",
    Measure="cm",
    typeIndex=-1)
profile_19 = CreateProfile(
    Depth_cm="500",
    TopWidth_cm="100",
    BottomWidth_cm="10",
    TopLip_cm="20",
    Lip_cm="30",
    Thickness_cm="30",
    catalogueIndex=-1,
    inclSS=False,
    lengthUnit="Centimeter",
    mode="Other",
    Profile_type="General Z",
    Measure="cm",
    typeIndex=-1)
profile_20 = CreateProfile(
    Depth_cm="500",
    Width_cm="100",
    WebThk_cm="10",
    FlangeThk_cm="20",
    catalogueIndex=-1,
    inclSS=False,
    lengthUnit="Centimeter",
    mode="Other",
    Profile_type="Rectangle Hollow",
    Measure="cm",
    typeIndex=-1)
profile_21 = CreateProfile(
    Depth_cm="500",
    Width_cm="100",
    TopFlangeWidth_cm="10",
    BottomFlangeWidth_cm="20",
    FlangeThickness_cm="30",
    WebThickness_cm="30",
    catalogueIndex=-1,
    inclSS=False,
    lengthUnit="Centimeter",
    mode="Other",
    Profile_type="Sheet Pile",
    Measure="cm",
    typeIndex=-1)
profile_22 = CreateProfile(
    Depth_cm="500",
    Width_cm="100",
    WebThk_cm="10",
    FlangeThk_cm="20",
    catalogueIndex=-1,
    inclSS=False,
    lengthUnit="Centimeter",
    mode="Other",
    Profile_type="T Section",
    Measure="cm",
    typeIndex=-1)
profile_23 = CreateProfile(
    Depth_cm="500",
    Width_cm="100",
    Thickness_cm="10",
    catalogueIndex=-1,
    inclSS=False,
    lengthUnit="Centimeter",
    mode="Other",
    Profile_type="Ellipse Hollow",
    Measure="cm",
    typeIndex=-1)
profile_24 = CreateProfile(
    Depth_cm="500",
    Width_cm="100",
    catalogueIndex=-1,
    inclSS=False,
    lengthUnit="Centimeter",
    mode="Other",
    Profile_type="Ellipse",
    Measure="cm",
    typeIndex=-1)
lng = ListLength(List=profile)

# ---- group: I Beam Asysmmetrical
txt = Text(profile_6)

# ----
lng_2 = ListLength(List=profile_3)

# ---- group: I Beam Cellular
txt_2 = Text(profile_18)

# ---- group: Trapezoid
txt_3 = Text(profile_7)

# ---- group: Ellipse Hollow
txt_4 = Text(profile_23)

# ---- group: I Beam Symmetrical
txt_5 = Text(profile_5)

# ---- group: Channel
txt_6 = Text(profile_14)

# ---- group: IPE100
txt_7 = Text(profile_2)

# ---- group: Perimeter
txt_8 = Text(profile_4)

# ---- group: T Section
txt_9 = Text(profile_22)

# ---- group: Circle
txt_10 = Text(profile_9)

# ---- group: Rectangle Hollow
txt_11 = Text(profile_20)

# ---- group: Sheet Pile
txt_12 = Text(profile_21)

# ---- group: Angle
txt_13 = Text(profile_8)

# ---- group: Circle Hollow
txt_14 = Text(profile_16)

# ---- group: Ellipse
txt_15 = Text(profile_24)

# ---- group: Recto Circle
txt_16 = Text(profile_11)

# ---- group: Secant Pile
txt_17 = Text(profile_12)

# ---- group: Cruciform Symmetrical
txt_18 = Text(profile_10)

# ---- group: General C
txt_19 = Text(profile_17)

# ---- group: Recto Ellipse
txt_20 = Text(profile_13)

# ---- group: Rectangle
txt_21 = Text(profile_15)

# ---- group: General Z
txt_22 = Text(profile_19)

# ----
panel = Panel(txt_12)
panel_2 = Panel(txt_3)
panel_3 = Panel(txt_17)
panel_4 = Panel(txt_9)
panel_5 = Panel(txt_5)
panel_6 = Panel(txt)
panel_7 = Panel(txt_7)
panel_8 = Panel(txt_14)
panel_9 = Panel(txt_2)
panel_10 = Panel(txt_11)
panel_11 = Panel(txt_22)
panel_12 = Panel(txt_8)
panel_13 = Panel(txt_13)
panel_14 = Panel(txt_21)
panel_15 = Panel(txt_16)
panel_16 = Panel(txt_6)
panel_17 = Panel(txt_10)
panel_18 = Panel(txt_19)
panel_19 = Panel(txt_20)

# ---- group: Count
int = Integer(lng_2)

# ----
panel_20 = Panel(txt_18)
panel_21 = Panel(txt_4)
panel_22 = Panel(txt_15)

# ---- group: CountSuperseeded
int_2 = Integer(lng)

# ----
panel_23 = Panel(int)
panel_24 = Panel(int_2)
